# Grasshopper definition EJERCICIO 1.gh (Grasshopper 1.0.7)

number_slider = Slider(40, range=0..100)

pt_1 = ConstructPoint(XCoordinate=0, YCoordinate=0, ZCoordinate=0)
pt_3 = ConstructPoint(XCoordinate=number_slider, YCoordinate=0, ZCoordinate=0)
pt_4 = ConstructPoint(XCoordinate=number_slider, YCoordinate=number_slider, ZCoordinate=0)
pt_2 = ConstructPoint(XCoordinate=0, YCoordinate=number_slider, ZCoordinate=0)

ln_1 = Line(StartPoint=pt_1, EndPoint=pt_2)
ln_3 = Line(StartPoint=pt_2, EndPoint=pt_4)
ln_4 = Line(StartPoint=pt_3, EndPoint=pt_4)
ln_2 = Line(StartPoint=pt_1, EndPoint=pt_3)
group = Group(Objects=[ln_2, ln_1, ln_3, ln_4])
